# Grasshopper definition ARch_ACTIVE BENDING REED.gh (Grasshopper 1.0.8)
# plug-ins: Karamba3D, Kangaroo2 Components

# ---- group: Model Set Up Parameters
required_length_units = ValueList({"m": 0, "mm": 1, "cm": 2}, selected="m")
climate = ValueList({"Warm": 0, "Cold(3-5 months of wind/rain/snow)": 1}, selected="Warm")
required_stress_units_e_karamba = ValueList({"GPA": 0, "KN/cm2": 1, "MPa (N/mm2)": 2, "Pa(N/m2)": 3}, selected="KN/cm2")
required_strength_units = ValueList({"MPa": 0, "KN/cm2": 1, "GPa": 2}, selected="KN/cm2")
required_stress_units_e_karamba_2 = ValueList({"GPA": 0, "KN/cm2": 1, "MPa (N/mm2)": 2, "Pa(N/m2)": 3}, selected="GPA")

# ---- group: User Inputs
panel = Panel("650")  # "kg/m3"
panel_2 = Panel("9.81")
module_center_height_mm = Slider(2500, range=2000..3000)
bundle_length_mm = Slider(7018, range=1000..50000)
number_of_occupants = Slider(4, range=0..100)
edge_arch_height_mm = Slider(2100, range=2000..3000)
bundle_radius_mm = Slider(15, range=0..200)
module_side_mm = Slider(2500, range=1000..6000)
expression = Expression(rho=panel, g=panel_2, Expression="(rho*g)/1000")
chosen_origin_point = Brep(<brep referenced from the Rhino model>)
terrain_mesh = Mesh(<mesh referenced from the Rhino model>)
specific_weight_kn_m3 = Panel(expression)

# ----
panel_3 = Panel("Warm Climates")
panel_4 = Panel("""Cold
Climates""")
m2_per_person_unhcr = Panel("3.5")
m2_per_person_unhcr_2 = Panel("5.5")

# ---- group: Conversions - mm to...
mm_to_m_multiplier = Panel("1000")
mm_to_mm_multiplier = Panel("1")
mm_to_cm_multiplier = Panel("10")

# ---- group: Conversions - GPa to...
gpa_to_gpa = Panel("1")
gpa_to_mpa = Panel("1000")
gpa_to_pa = Panel("1000000000")

# ----
gpa_to_kn_cm2 = Panel("100")
mpa_to_kn_cm2 = Panel("0.1")

# ---- group: Conversions - MPa to...
mpa_to_mpa = Panel("1")
mpa_to_gpa = Panel("1000")

# ----
flexural_strength_reed_mpa = Panel("51.3")
young_s_modulus_reed_gpa = Panel("7")

# ----
# INPUTS
# LOCAL MATERIAL PROPERTIES & CALCULATIONS
# JULIAN LEINHARD
expression_2 = Expression(E=young_s_modulus_reed_gpa, Expression="E*1000")
young_s_modulus_mpa_n_mm2 = Panel(expression_2)
panel_5 = Panel(young_s_modulus_mpa_n_mm2)

# ---- group: Equation from Julian Leinhard
# JULIAN LEINHARD
expression_3 = Expression(r=bundle_radius_mm, Expression="2*r")
expression_4 = Expression(E=young_s_modulus_mpa_n_mm2, d=expression_3, sigma=flexural_strength_reed_mpa, Expression="(E*d)/(2*sigma)")
minimum_curvature_radius_mm = Panel(expression_4)

# ----
expression_5 = Expression(r=bundle_radius_mm, Expression="(pi*r^4)/4")
second_moment_of_inertia_i_mm4 = Panel(expression_5)

# ---- group: Equation from Ayaka Thesis
# FROM AYAKA THESIS
expression_6 = Expression(r=bundle_radius_mm, Expression="13.9*(2*r)-29.2")
flexural_strength_mpa = Panel(expression_6)
expression_7 = Expression(E=young_s_modulus_mpa_n_mm2, I=expression_5, sigma=expression_6, L=bundle_length_mm, Expression="((4*E*I)/(sigma*L))*2")
minimum_curvature_radius_mm_2 = Panel(expression_7)

# ---- group: Standard Curvature Equation (Str Mechanics)
# STANDARD STRUCTURAL MECHANICS EQ.
expression_8 = Expression(r=bundle_radius_mm, Expression="pi*r^2")
expression_9 = Expression(E=young_s_modulus_reed_gpa, Expression="E*1000")
expression_10 = Expression(sigma=flexural_strength_reed_mpa, A=expression_8, Expression="sigma*A")
young_s_modulus_mpa_n_mm2_2 = Panel(expression_9)
force_n = Panel(expression_10)
expression_11 = Expression(F=expression_10, L=bundle_length_mm, Expression="F*(L/2)")
moment_nmm = Panel(expression_11)
expression_12 = Expression(E=expression_9, I=expression_5, M=expression_11, Expression="((4*E*I)/M)*2")
minimum_radius_of_curvature_mm = Panel(expression_12)

# ----
# REQUIRED AREA OF THE SHELTER
climate_stream_filter = StreamFilter(Gate=climate, Stream0=m2_per_person_unhcr, Stream1=m2_per_person_unhcr_2)
area_pp = Panel(climate_stream_filter)
multiplication = Multiplication(A=number_of_occupants, B=area_pp)
required_area_shelter_unit2 = Panel(multiplication)

# ----
# LOCAL MATERIAL PROPERTIES
units_stream_filter = StreamFilter(Gate=required_stress_units_e_karamba, Stream0=gpa_to_gpa, Stream1=gpa_to_kn_cm2, Stream2=gpa_to_mpa, Stream3=gpa_to_pa)
poisson_s_ratio = Panel("0.80")
multiplication_2 = Multiplication(A=young_s_modulus_reed_gpa, B=units_stream_filter)
E = Expression(E=multiplication_2, We=poisson_s_ratio, Expression="E/(2*(1+We))")
young_s_modulus = Panel(multiplication_2)
shear_modulus_g = Panel(E)

# ----
# MODULE DIMENSIONS
units_stream_filter_2 = StreamFilter(Gate=required_length_units, Stream0=mm_to_m_multiplier, Stream1=mm_to_mm_multiplier, Stream2=mm_to_cm_multiplier)
division = Division(A=bundle_radius_mm, B=units_stream_filter_2)
division_2 = Division(A=edge_arch_height_mm, B=units_stream_filter_2)
division_3 = Division(A=module_side_mm, B=units_stream_filter_2)
division_4 = Division(A=module_center_height_mm, B=units_stream_filter_2)
division_5 = Division(A=minimum_curvature_radius_mm, B=units_stream_filter_2)
center_height = Panel(division_4)
edge_height = Panel(division_2)
minimum_curvature_radius = Panel(division_5)
side_length = Panel(division_3)
bundle_radius = Panel(division)
square = Square(Value=side_length)
single_module_area_unit2 = Panel(square)

units_stream_filter_3 = StreamFilter(Gate=required_stress_units_e_karamba_2, Stream0=gpa_to_gpa, Stream1=gpa_to_kn_cm2, Stream2=gpa_to_mpa, Stream3=gpa_to_pa)
units_stream_filter_4 = StreamFilter(Gate=required_strength_units, Stream0=mpa_to_mpa, Stream1=mpa_to_kn_cm2, Stream2=mpa_to_gpa)
multiplication_3 = Multiplication(A=young_s_modulus_reed_gpa, B=units_stream_filter_3)
multiplication_4 = Multiplication(A=flexural_strength_reed_mpa, B=units_stream_filter_4)
young_s_modulus_2 = Panel(multiplication_3)
flexural_strength = Panel(multiplication_4)

division_6 = Division(A=required_area_shelter_unit2, B=single_module_area_unit2)
round = Round(Number=division_6)  # -> Nearest, Floor, Ceiling
no_modules_required = Panel(round.Ceiling)

# ----
# ANALYSIS
# STRUCTURAL ANALYSIS_HAND CALCS.
number_of_modules = Data(no_modules_required)
equality = Equality(FirstNumber="1", SecondNumber=number_of_modules)  # -> Equality, Inequality

# ----
# FLATPACKING AND LABELLING OF  STRUCTURAL ELEMENTS (FOR UNITY)
bundel_radius = Data(bundle_radius)

# ----
# Material Properties
tensile_and_compressive_s = Data(flexural_strength)
young_s_modulus_3 = Data(young_s_modulus)
data = Data(shear_modulus_g)
density = Data(specific_weight_kn_m3)
radius_of_bundle = Data(bundle_radius)
negative = Negative(Value=tensile_and_compressive_s)
made_up_g = Panel("250")
flexural_strength_2 = Panel(tensile_and_compressive_s)
panel_6 = Panel(young_s_modulus_3)
from_formula = Panel(data)
material_properties_karamba3d = MatProps(
    FamilyOfMaterial="Wood",
    Name=" Reed bundle",
    YoungsModulus_kN_cm²=young_s_modulus_3,
    InPlaneShearModulus_kN_cm²=made_up_g,
    TransverseShearModulus_kN_cm²=made_up_g,
    SpecificWeight_kN_m³=density,
    CoefficientOfThermalExpansion_1=1.2e-05,
    TensileStrength_kN_cm²=flexural_strength_2,
    CompressiveStrength_kN_cm²=negative,
    StrengthHypothesis="MISES",
    mode="Isotrop")
expression_13 = Expression(r=radius_of_bundle, scale="100", Expression="2*r*scale")
division_7 = Division(A=expression_13, B="2")
cross_section_karamba3d = CroSec(
    FamilyNameOfCrossSection="DefaultCroSec",
    Material=material_properties_karamba3d,
    Diameter_cm=expression_13,
    WallThickness_cm=expr("x/2", expression_13),
    mode="Circular Hollow")
cross_section_karamba3d_2 = CroSec(
    FamilyNameOfCrossSection="DefaultCroSec",
    Material=material_properties_karamba3d,
    Diameter_cm=division_7,
    WallThickness_cm=expr("x/2", division_7),
    mode="Circular Hollow")

# ----
# Loads
loads_karamba3d = Loads(Vector=Vector(0, 0, -1), LCase="LC0", mode="Gravity")

# ----
# PROCESSING
# MAKING STRUCTURE
# SETTING UP THE SITE
site = Data(terrain_mesh)

# ----
# TERRAIN MESH
bounding_box = BoundingBox(Content=site, Plane=PlaneXY(0, 0, 0), UnionBox=True)  # -> Box, Box_2
deconstruct_box = DeconstructBox(Box=bounding_box.Box)  # -> Plane, X, Y, Z
deconstruct_domain = DeconstructDomain(Domain=deconstruct_box.Z)  # -> Start, End
unit_z = UnitZ(Factor=expr("-x", deconstruct_domain.Start))
move = Move(Geometry=site, Motion=unit_z)  # -> Geometry, Transform

# ----
# SETTING  THE ORIGIN
volume = Volume(Geometry=chosen_origin_point)  # -> Volume, Centroid
pt = Point(volume.Centroid)
mesh_closest_point = MeshClosestPoint(Point=pt, Mesh=move.Geometry)  # -> Point, Index, Parameter

# ----
# MODULARISING THE SITE
text_tag = TextTag(Location=mesh_closest_point.Point, Text="Origin Point")
sphere = Sphere(Base=mesh_closest_point.Point, Radius="0.1")

# ----
# CONTORING THE SITE
project = Project(Geometry=terrain_mesh, Plane=PlaneXY(0, 0, 0))  # -> Geometry, Transform
bounding_box_2 = BoundingBox(Content=project.Geometry, Plane=PlaneXY(0, 0, 0), UnionBox=True)  # -> Box, Box_2
deconstruct_brep = DeconstructBrep(Brep=bounding_box_2.Box)  # -> Faces, Edges, Vertices
length = Length(Curve=deconstruct_brep.Edges)
sort_list = SortList(Keys=length)  # -> Keys, ValuesValuesA
list_item = ListItem(List=sort_list.Keys, Index=0, Wrap=True)  # -> Item1, Item
division_8 = Division(A=list_item.Item1, B=division_3)
division_9 = Division(A=list_item.Item, B=division_3)
divide_surface = DivideSurface(Surface=bounding_box_2.Box, UCount=division_9, VCount=division_8)  # -> Points, Normals, Parameters
rotate = Rotate(Geometry=divide_surface.Points, Angle=degrees(Slider(37, range=0..180)), Plane=PlaneXY(0, 0, 0))  # -> Geometry, Transform
unit_z_2 = UnitZ(Factor=1)
mesh_ray = MeshRay(Mesh=move.Geometry, Point=rotate.Geometry, Direction=unit_z_2)  # -> Point, Hit

# ----
# MAKING GRID ON THE SITE
cull_index = CullIndex(List=mesh_ray.Point, Indices=-1, Wrap=True)
cull_index_2 = CullIndex(List=mesh_ray.Point, Indices=0, Wrap=True)
line = Line(StartPoint=cull_index_2, EndPoint=cull_index)  # -> simplify(Line)
graft_tree = GraftTree(Tree=line, IncludeEmptyLists=True, IncludeNullItems=True)
tree_statistics = TreeStatistics(Tree=line)  # -> Paths, Length, Count
tree_statistics_2 = TreeStatistics(Tree=graft_tree)  # -> Paths, Length, Count
list_item_2 = ListItem(List=tree_statistics.Paths, Index=0, Wrap=True)  # -> Item1, Item
deconstruct_path = DeconstructPath(Branch=list_item_2.Item)
deconstruct_path_2 = DeconstructPath(Branch=list_item_2.Item1)
deconstruct_path_3 = DeconstructPath(Branch=tree_statistics_2.Paths)
list_item_3 = ListItem(List=deconstruct_path_3, Index=0, Wrap=True)  # -> simplify(Item)
equality_2 = Equality(FirstNumber=list_item_3, SecondNumber=deconstruct_path)  # -> flatten(Equality), Inequality
equality_3 = Equality(FirstNumber=list_item_3, SecondNumber=deconstruct_path_2)  # -> flatten(Equality), Inequality
dispatch = Dispatch(List=tree_statistics_2.Paths, DispatchPattern=equality_2.Equality)  # -> ListA, ListB
dispatch_2 = Dispatch(List=tree_statistics_2.Paths, DispatchPattern=equality_3.Equality)  # -> ListA, ListB
split_tree = SplitTree(Data=graft_tree, Masks=flatten(dispatch.ListB))  # -> Positive, Negative
split_tree_2 = SplitTree(Data=graft_tree, Masks=flatten(dispatch_2.ListB))  # -> Positive, Negative
tree_statistics_3 = TreeStatistics(Tree=split_tree.Positive)  # -> Paths, Length, Count
deconstruct_path_4 = DeconstructPath(Branch=tree_statistics_3.Paths)
list_item_4 = ListItem(List=deconstruct_path_4, Index=0, Wrap=True)  # -> Item, Item1
subtraction = Subtraction(A=list_item_4.Item, B=1)
merge = Merge(Data1=subtraction, Data2=list_item_4.Item1)  # -> simplify(Result)
construct_path = ConstructPath(Indices=merge)  # -> flatten(Branch)
replace_paths = ReplacePaths(Data=split_tree.Positive, Search=tree_statistics_3.Paths, Replace=construct_path)
flip_curve = FlipCurve(Curve=replace_paths)  # -> Curve, Flag
merge_2 = Merge(Data1=split_tree_2.Positive, Data2=flip_curve.Curve)
clean_tree = CleanTree(RemoveNulls=True, RemoveInvalid=True, RemoveEmpty=False, Tree=merge_2)
tree_statistics_4 = TreeStatistics(Tree=clean_tree)  # -> Paths, Length, Count
larger_than = LargerThan(FirstNumber=tree_statistics_4.Length, SecondNumber=2)  # -> LargerThan, OrEqualTo
dispatch_3 = Dispatch(List=tree_statistics_4.Paths, DispatchPattern=larger_than.OrEqualTo)  # -> ListA, ListB
split_tree_3 = SplitTree(Data=clean_tree, Masks=flatten(dispatch_3.ListA))  # -> Positive, Negative
connect_curves = ConnectCurves(Curves=split_tree_3.Positive, Continuity=2, Close=True, Bulge=0)
project_2 = Project(Geometry=connect_curves, Plane=PlaneXY(0, 0, 0))  # -> Geometry, Transform
explode = Explode(Curve=project_2.Geometry, Recursive=True)  # -> Segments, Vertices
list_item_5 = ListItem(List=connect_curves, Index=0, Wrap=True)
explode_2 = Explode(Curve=list_item_5, Recursive=True)  # -> Segments, Vertices
length_2 = Length(Curve=explode.Segments)
list_item_6 = ListItem(List=explode_2.Vertices, Index=0, Wrap=True)  # -> Item, Item1, Item2, Item3
panel_7 = Panel(length_2)
_4point_surface = _4PointSurface(CornerA=list_item_6.Item, CornerB=list_item_6.Item1, CornerC=list_item_6.Item2, CornerD=list_item_6.Item3)
flatten_tree = FlattenTree(Tree=_4point_surface, Path="{0}")

# ----
# SELECTING REQUIRED NO OF MODULES
incurve = PointInCurve(Point=mesh_closest_point.Point, Curve=flatten_tree)  # -> Relationship, Point
dispatch_4 = Dispatch(List=flatten_tree, DispatchPattern=incurve.Relationship)  # -> ListA, ListB
brep = Brep(dispatch_4.ListA)
brep_2 = Brep(dispatch_4.ListB)
area = Area(Geometry=brep_2)  # -> Area, Centroid
cps = ClosestPoints(Point=pt, Cloud=area.Centroid, Count=expr("x-1", no_modules_required))  # -> ClosestPoint, CPIndex, Distance
item = ListItem(List=brep_2, Index=cps.CPIndex, Wrap=True)
merge_3 = Merge(Data1=brep, Data2=item)  # -> flatten(Result)

# ----
# GETTING THE FINAL BOUNDARY POLYLINES FOR  THE SELECTED MODULES
control_polygon = ControlPolygon(Curve=merge_3)  # -> Polygon, Points
discontinuity = Discontinuity(Curve=control_polygon.Polygon, Level=1)  # -> Points, Parameters
sort_along_curve = SortAlongCurve(Points=discontinuity.Points, Curve=simplify(graft(control_polygon.Polygon)))  # -> Points, Indices
deconstruct = Deconstruct(Point=sort_along_curve.Points)  # -> XComponent, YComponent, ZComponent
sort_list_2 = SortList(Keys=deconstruct.ZComponent)  # -> Keys, ValuesValuesA
list_item_7 = ListItem(List=reverse(sort_list_2.Keys), Index=0, Wrap=True)
construct_point = ConstructPoint(XCoordinate=deconstruct.XComponent, YCoordinate=deconstruct.YComponent, ZCoordinate=list_item_7)
shift_list = ShiftList(List=construct_point, Shift=1, Wrap=True)
line_2 = Line(StartPoint=construct_point, EndPoint=shift_list)
join_curves = JoinCurves(Curves=line_2, Preserve=False)  # -> simplify(Curves)

# ----
# MAKING PRELIMINARY ARCHES
# Primary structural members
explode_3 = Explode(Curve=join_curves, Recursive=True)  # -> Segments, Vertices
curve_middle = CurveMiddle(Curve=explode_3.Segments)
area_2 = Area(Geometry=merge_3)  # -> Area, Centroid
end_points = EndPoints(Curve=explode_3.Segments)  # -> Start, End
unit_z_3 = UnitZ(Factor=edge_height)
unit_z_4 = UnitZ(Factor=center_height)
split_list = SplitList(List=end_points.Start, Index="2")  # -> ListA, ListB
move_2 = Move(Geometry=curve_middle, Motion=unit_z_3)  # -> Geometry, Transform
move_3 = Move(Geometry=area_2.Centroid, Motion=unit_z_4)  # -> graft(Geometry), Transform
arc_3pt = Arc3Pt(PointA=end_points.Start, PointB=move_2.Geometry, PointC=end_points.End)  # -> simplify(Arc), Plane, Radius
arc_3pt_2 = Arc3Pt(PointA=split_list.ListA, PointB=move_3.Geometry, PointC=split_list.ListB)  # -> simplify(Arc), Plane, Radius
insert_items = InsertItems(List=arc_3pt.Arc, Item=arc_3pt_2.Arc, Indices=4, Wrap=True)  # -> simplify(List)

data_2 = Data(insert_items)
modules_pl = Data(control_polygon.Polygon)
data_3 = Data(construct_point)
data_4 = Data(sort_along_curve.Points)

# ----
# MAKING FOUNDATION TIRES
sort_along_curve_2 = SortAlongCurve(Points=data_4, Curve=simplify(graft(modules_pl)))  # -> flatten(Points), Indices
sort_along_curve_3 = SortAlongCurve(Points=data_3, Curve=simplify(graft(modules_pl)))  # -> Points, Indices
graft_tree_2 = GraftTree(Tree=sort_along_curve_3.Points, IncludeEmptyLists=True, IncludeNullItems=True)  # -> simplify(Tree)
flatten_tree_2 = FlattenTree(Tree=sort_along_curve_3.Points, Path="{0}")  # -> simplify(Tree)
cross_reference = CrossReference(ListListA=graft_tree_2, ListListB=flatten_tree_2, CrossMode=1)  # -> ListListA, ListListB
distance = Distance(PointA=cross_reference.ListListA, PointB=cross_reference.ListListB)
smaller_than = SmallerThan(FirstNumber=distance, SecondNumber="0.2")  # -> SmallerThan, OrEqualTo
dispatch_5 = Dispatch(List=flatten_tree_2, DispatchPattern=smaller_than.SmallerThan)  # -> ListA, ListB
average = Average(Input=dispatch_5.ListA)
tire = Mesh(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)
line_3 = Line(StartPoint=flatten(average), EndPoint=sort_along_curve_2.Points)  # -> simplify(Line)
bounding_box_3 = BoundingBox(Content=tire, Plane=PlaneXY(0, 0, 0), UnionBox=True)  # -> Box, Box_2
divide_length = DivideLength(Curve=line_3, Length="0.2")  # -> Points, Tangents, simplify(Parameters)
deconstruct_brep_2 = DeconstructBrep(Brep=bounding_box_3.Box)  # -> Faces, Edges, Vertices
area_3 = Area(Geometry=deconstruct_brep_2.Faces)  # -> Area, Centroid
shatter = Shatter(Curve=line_3, Parameters=divide_length.Parameters)
deconstruct_2 = Deconstruct(Point=area_3.Centroid)  # -> XComponent, YComponent, ZComponent
end_points_2 = EndPoints(Curve=shatter)  # -> Start, End
sort_list_3 = SortList(Keys=deconstruct_2.ZComponent, ValuesValuesA=area_3.Centroid)  # -> Keys, ValuesValuesA
list_item_8 = ListItem(List=sort_list_3.ValuesValuesA, Index=0, Wrap=True)
orient = Orient(Geometry=tire, Source=list_item_8, Target=end_points_2.End)  # -> Geometry, Transform

# ----
# KANGAROO FORM FINDING
# Primary structural members
# Note | Units: According to ChatGPT - Kangaroo expects bending strength as EI and axial/length strength as EA/L
expression_14 = Expression(r=bundle_radius, Expression="pi*(r^2)")
expression_15 = Expression(r=bundle_radius, Expression="(pi/64)*((r*2)^4)")
length_3 = Length(Curve=data_2)
round_2 = Round(Number=length_3)  # -> Nearest, Floor, Ceiling
number_slider = Slider(50, range=0..100)
cross_sectional_area_mm2_a = Panel(expression_14)
rib_length_mm_l = Panel(round_2.Nearest)
moment_of_inertia_i = Panel(expression_15)
axial_strength = Expression(E=young_s_modulus, A=cross_sectional_area_mm2_a, L=rib_length_mm_l, Expression="(E*A)/L")
divide_curve = DivideCurve(Curve=data_2, Count=number_slider, Kinks=False)  # -> Points, Tangents, Parameters
bending_strength = Expression(E=young_s_modulus, I=moment_of_inertia_i, Expression="E*I")
end_points_3 = EndPoints(Curve=data_2)  # -> Start, End
polyline = PolyLine(Vertices=divide_curve.Points, Closed=False)  # -> simplify(Polyline)
point = Point(end_points_3.Start)
point_2 = Point(end_points_3.End)
bending_stiffness = Panel(bending_strength)
merge_4 = Merge(Data1=point, Data2=point_2)
rod = Rod(Polyline=polyline, LengthFactor=1, AngleFactor="0", AxialStrength=graft(axial_strength), BendStrength=bending_strength)  # -> simplify(R)
anchor = Anchor(Point=merge_4, Strength=10000)  # -> simplify(graft(A))
show = Show(G=merge_4)
merge_5 = Merge(Data2=anchor, Data3=rod)

solver = Solver(GoalObjects=merge_5, Reset=Button(), Threshold=1e-15, Tolerance=0.0001, On=Toggle(True))  # -> I, V, O

data_dam = DataDam(DataDataA=solver.O, BufferDelay=10000000, BufferMode=0)

# ----
# DERIVING CURVATURES
boolean_toggle = BooleanToggle(True)
clean_tree_2 = CleanTree(RemoveNulls=True, RemoveInvalid=True, RemoveEmpty=boolean_toggle, Tree=data_dam)
end_points_4 = EndPoints(Curve=clean_tree_2)  # -> Start, End
pipe = Pipe(Curve=clean_tree_2, Radius=bundle_radius, Caps=0)
removeduplicatepts = RemoveDuplicatePts(Points=[end_points_4.Start, end_points_4.End], Tolerance=0.01)
interpolate = Interpolate(Vertices=removeduplicatepts, Degree=3, Periodic=False, KnotStyle=1)  # -> Curve, Length, Domain
curvature = Curvature(Curve=reparameterize(interpolate.Curve), Parameter=Slider(0.5, range=0..1))  # -> Point, simplify(Curvature), Curvature_2
area_4 = Area(Geometry=curvature.Curvature_2)  # -> Area, simplify(Centroid)
distance_2 = Distance(PointA=simplify(curvature.Point), PointB=simplify(area_4.Centroid))
trim_tree = TrimTree(Tree=distance_2, Depth=1)
stream_filter = StreamFilter(Gate=equality.Inequality, Stream0=flatten(distance_2), Stream1=trim_tree)

# ----
# DIVIDING 1 ARCH TO 2 SEGMENTS
arched_elements = Data(simplify(interpolate.Curve))
shatter_2 = Shatter(Curve=reparameterize(arched_elements), Parameters="0.5")  # -> simplify(Segments)
number_slider_2 = Slider(0.5, range=0..1)
dispatch_6 = Dispatch(List=shatter_2, DispatchPattern=[True, False])  # -> ListA, ListB
extend_curve = ExtendCurve(Curve=dispatch_6.ListA, Type="1", Start="0", End=number_slider_2)
extend_curve_2 = ExtendCurve(Curve=dispatch_6.ListB, Type="1", Start=number_slider_2, End="0")
merge_6 = Merge(Data1=extend_curve, Data2=extend_curve_2)

# ---- group: Arched overlapping elements
pipe_2 = Pipe(Curve=merge_6, Radius=bundel_radius, Caps=0)  # -> simplify(Pipe)

# ----
# CREATING TIES
# Secondary Members
curve_middle_2 = CurveMiddle(Curve=interpolate.Curve)
trim_tree_2 = TrimTree(Tree=curve_middle_2, Depth=1)
trim_tree_3 = TrimTree(Tree=trim_tree_2, Depth=1)
stream_filter_2 = StreamFilter(Gate=equality.Inequality, Stream0=flatten(trim_tree_2), Stream1=trim_tree_3)
list_item_9 = ListItem(List=stream_filter_2, Index=0, Wrap=True)  # -> Item, Item1, Item2, Item3, Item4, Item5
arc_3pt_3 = Arc3Pt(PointA=list_item_9.Item, PointB=list_item_9.Item4, PointC=list_item_9.Item2)  # -> Arc, Plane, Radius
arc_3pt_4 = Arc3Pt(PointA=list_item_9.Item1, PointB=list_item_9.Item5, PointC=list_item_9.Item3)  # -> Arc, Plane, Radius
merge_7 = Merge(Data1=arc_3pt_3.Arc, Data2=arc_3pt_4.Arc)  # -> graft(Result)
divide_curve_2 = DivideCurve(Curve=merge_7, Count=number_slider, Kinks=False)  # -> Points, Tangents, Parameters
trim_tree_4 = TrimTree(Tree=divide_curve_2.Points, Depth=1)
trim_tree_5 = TrimTree(Tree=removeduplicatepts, Depth=1)
shatter_3 = Shatter(Curve=merge_7, Parameters=divide_curve_2.Parameters)  # -> simplify(Segments)
trim_tree_6 = TrimTree(Tree=trim_tree_4, Depth=1)
trim_tree_7 = TrimTree(Tree=trim_tree_5, Depth=1)
stream_filter_3 = StreamFilter(Gate=equality.Inequality, Stream0=flatten(trim_tree_5), Stream1=trim_tree_7)
merge_8 = Merge(Data1=trim_tree_6, Data2=stream_filter_3)

end_points_5 = EndPoints(Curve=interpolate.Curve)  # -> Start, End
merge_9 = Merge(Data1=end_points_5.Start, Data2=end_points_5.End)  # -> simplify(Result)
trim_tree_8 = TrimTree(Tree=merge_9, Depth=1)
# COMPARISON
stream_filter_4 = StreamFilter(Gate=equality.Inequality, Stream0=flatten(merge_9), Stream1=trim_tree_8)

# ----
# SKIN OF THE STRUCTURE
trim_tree_9 = TrimTree(Tree=interpolate.Curve, Depth=1)
construct_domain = ConstructDomain(DomainStart="0", DomainEnd="3")
trim_tree_10 = TrimTree(Tree=trim_tree_9, Depth=1)
stream_filter_5 = StreamFilter(Gate=equality.Inequality, Stream0=flatten(trim_tree_9), Stream1=trim_tree_10)
sub_list = SubList(List=stream_filter_5, Domain=construct_domain, Wrap=True)  # -> List, Index
join_curves_2 = JoinCurves(Curves=simplify(sub_list.List), Preserve=False)
delaunay_mesh = DelaunayMesh(Points=merge_8, Plane=PlaneXY(0, 0, 0))
face_boundaries = FaceBoundaries(Mesh=delaunay_mesh)
patch = Patch(Curves=face_boundaries, Points=merge_8, Spans=20, Flexibility=1, Trim=True)
surface_split = SurfaceSplit(Surface=patch, Curves=join_curves_2)
curve_middle_3 = CurveMiddle(Curve=arc_3pt_4.Arc)
collision_one_many = CollisionOneMany(Collider=curve_middle_3, Obstacles=simplify(surface_split))  # -> Collision, Index
list_item_10 = ListItem(List=surface_split, Index=collision_one_many.Index, Wrap=True)
surface_closest_point = SurfaceClosestPoint(Point=stream_filter_4, Surface=list_item_10)  # -> simplify(Point), UVPoint, Distance

# ---- group: curvatures of the arches
data_5 = Data(stream_filter)

# ----
# STRUCTURAL CHECKS
# Stresses
expression_16 = Expression(r=bundel_radius, Expression="2*r")
expression_17 = Expression(E=young_s_modulus_2, d=expression_16, R=data_5, Expression="(E*d)/(2*R)")
flexural_strength_ayaka_formula_bundle = Data(flexural_strength_mpa)
flexural_strength_one_reed = Data(flexural_strength_reed_mpa)
sigma_max_n_m2 = Panel(expression_17)
expression_18 = Expression(sigma=expression_17, Expression="sigma*1000")
allow_stress_mpa = Panel(flexural_strength_one_reed)
allow_stress_mpa_2 = Panel(flexural_strength_ayaka_formula_bundle)
max_stress_mpa = Panel(expression_18)
smaller_than_2 = SmallerThan(FirstNumber=max_stress_mpa, SecondNumber=allow_stress_mpa)  # -> SmallerThan, OrEqualTo
smaller_than_3 = SmallerThan(FirstNumber=max_stress_mpa, SecondNumber=allow_stress_mpa_2)  # -> SmallerThan, OrEqualTo
panel_8 = Panel(smaller_than_3.SmallerThan)
panel_9 = Panel(smaller_than_2.SmallerThan)

# ----
# STRUCTURAL CHECKS
# Min Curvature Radius
minimum_curvature_radius_julian = Data(minimum_curvature_radius)
minimum_curvature_radius_ayaka = Data(minimum_curvature_radius_mm_2)
division_10 = Division(A=minimum_curvature_radius_ayaka, B="1000")
larger_than_2 = LargerThan(FirstNumber=data_5, SecondNumber=minimum_curvature_radius_julian)  # -> LargerThan, OrEqualTo
panel_10 = Panel(division_10)
panel_11 = Panel(data_5)
panel_12 = Panel(minimum_curvature_radius_julian)
larger_than_3 = LargerThan(FirstNumber=data_5, SecondNumber=division_10)  # -> LargerThan, OrEqualTo
panel_13 = Panel(larger_than_2.LargerThan)
panel_14 = Panel(larger_than_3.LargerThan)

# ----
# ARUCO MARKERS POSITION
panel_15 = Panel("""0
1""")
evaluate_curve = EvaluateCurve(Curve=reparameterize(extend_curve), Parameter=panel_15)  # -> Point, Tangent, Angle
evaluate_curve_2 = EvaluateCurve(Curve=reparameterize(extend_curve_2), Parameter=panel_15)  # -> Point, Tangent, Angle
end_points_6 = EndPoints(Curve=merge_6)  # -> Start, End
plane_normal = PlaneNormal(Origin=evaluate_curve.Point, ZAxis=evaluate_curve.Tangent)
plane_normal_2 = PlaneNormal(Origin=evaluate_curve_2.Point, ZAxis=evaluate_curve_2.Tangent)
circle_cnr = CircleCNR(Center=evaluate_curve_2.Point, Normal=evaluate_curve_2.Tangent, Radius=expr("2*x", bundel_radius))
circle_cnr_2 = CircleCNR(Center=evaluate_curve.Point, Normal=evaluate_curve.Tangent, Radius=expr("2*x", bundel_radius))
merge_10 = Merge(Data1=end_points_6.Start, Data2=end_points_6.End)
boundary_surfaces = BoundarySurfaces(Edges=circle_cnr_2)
boundary_surfaces_2 = BoundarySurfaces(Edges=circle_cnr)
area_5 = Area(Geometry=boundary_surfaces)  # -> Area, Centroid
area_6 = Area(Geometry=boundary_surfaces_2)  # -> Area, Centroid
line_sdl = LineSDL(Start=area_5.Centroid, Direction=evaluate_curve.Tangent, Length="0.01")
line_sdl_2 = LineSDL(Start=area_6.Centroid, Direction=evaluate_curve_2.Tangent, Length="0.01")
extrude = Extrude(Base=boundary_surfaces, Direction=line_sdl)
extrude_2 = Extrude(Base=boundary_surfaces_2, Direction=line_sdl_2)
merge_11 = Merge(Data1=extrude, Data2=extrude_2)

# ---- group: ARCO Reference tracking points
arco_reference_points = Data(merge_10)

# ----
# Elements
number_slider_3 = Slider(0.3, range=0..1)
mesh_breps_karamba3d = MeshBreps(
    Brep=simplify(list_item_10),
    InclusionPoints=merge_8,
    MeshResolution=number_slider_3,
    EdgeRefinementFactor=0.67,
    PointReduction=False,
    SmoothingStepSize=0,
    SmoothingIterations=5)  # -> Mesh, Info
data_6 = Data(shatter_3)
data_7 = Data(clean_tree_2)
cross_section_karamba3d_3 = CroSec(FamilyNameOfCrossSection="DefaultCroSec", Material=material_properties_karamba3d, Height_cm="0.5", mode="Shell - Const")
trim_tree_11 = TrimTree(Tree=data_6, Depth=1)
trim_tree_12 = TrimTree(Tree=data_7, Depth=1)
stream_filter_6 = StreamFilter(Gate=equality.Inequality, Stream0=flatten(data_6), Stream1=trim_tree_11)
stream_filter_7 = StreamFilter(Gate=equality.Inequality, Stream0=flatten(data_7), Stream1=trim_tree_12)
create_linear_element_karamba3d = LineElem(
    Line=stream_filter_7,
    Identifier="Arch bundle",
    CrossSection=cross_section_karamba3d,
    LimitDistance_m=0.005,
    BucklingLengthY_m=-1,
    BucklingLengthZ_m=-1,
    BucklingLengthLT_m=-1,
    Bending=True,
    ToPolylineMaxAngle=0.03,
    ToPolylineTolerance=0.01,
    ToPolylineMaxEdgeLength=0.25,
    New=True,
    Remove=True,
    mode="LineToBeam")  # -> simplify(Element), Points, Info
create_linear_element_karamba3d_2 = LineElem(
    Line=stream_filter_6,
    Identifier="Secondary Arch bundle",
    CrossSection=cross_section_karamba3d_2,
    LimitDistance_m=0.005,
    BucklingLengthY_m=-1,
    BucklingLengthZ_m=-1,
    BucklingLengthLT_m=-1,
    Bending=True,
    ToPolylineMaxAngle=0.03,
    ToPolylineTolerance=0.01,
    ToPolylineMaxEdgeLength=0.25,
    New=True,
    Remove=True,
    mode="LineToBeam")  # -> simplify(Element), Points, Info
create_surface_element_karamba3d = SurfElem(
    Mesh=mesh_breps_karamba3d.Mesh,
    Identifier="skin",
    CrossSection=cross_section_karamba3d_3,
    LimitDistance_m=0.005,
    Bending=True,
    mode="MeshToShell")  # -> simplify(Element), Points, Info

# ----
# Supports
data_8 = Data(stream_filter_4)
data_9 = Data(surface_closest_point.Point)
support_karamba3d = Supp(PosInd=data_9, menu=[buttons(on, on, on, on, on, on)])
support_karamba3d_2 = Supp(PosInd=data_8, menu=[buttons(on, on, on, on, on, on)])

# ----
# STRUCTURAL ANALYSIS
# KARAMBA ANALYSIS
data_dam_2 = DataDam(
    DataSupports=support_karamba3d,
    DataSupportsMesh=support_karamba3d_2,
    DataArcElements=create_linear_element_karamba3d.Element,
    DataSecondaryElements=create_linear_element_karamba3d_2.Element,
    DataGravityLoads=loads_karamba3d,
    DataMesh=create_surface_element_karamba3d.Element,
    BufferDelay=10000000,
    BufferMode=0)  # -> DataSupports, DataSupportsMesh, DataArcElements, DataSecondaryElements, DataGravityLoads, DataMesh

# ----
# Analysis
assemble_model_karamba3d = Assemble(
    Elem=flatten([data_dam_2.DataArcElements, data_dam_2.DataSecondaryElements, data_dam_2.DataMesh]),
    Support=flatten([data_dam_2.DataSupports, data_dam_2.DataSupportsMesh]),
    Load=flatten(data_dam_2.DataGravityLoads),
    LimitDistance_m=0.005)  # -> Model, Info, Mass_kg, CentreOfGravity, LoadCaseNames
analyse_karamba3d = Analyse(Model=assemble_model_karamba3d.Model)  # -> AnalysedModel, MaximumDisplacement_cm, ResultingForce_kN, ChangeOfElasticEnergy_kNm
model_view_karamba3d = ModelView(Model=analyse_karamba3d.AnalysedModel)  # -> Model, DeformedMesh, DeformedAxes, DeformedModel, MaximumDeformation
panel_16 = Panel(model_view_karamba3d.MaximumDeformation)
beam_forces_karamba3d = BForces(AnalysedModel=model_view_karamba3d.Model, Ts=[0, 1])  # -> Model, NormalForce_kN, ShearForceVz_kN, ShearForceVy_kN, TorsionalMomentMt_kNm, BendingMomentMy_kNm, BendingMomentMz_kNm, LoadCaseIndex
shell_view_karamba3d = ShellView(Model=model_view_karamba3d.Model, IndexOfLayer=0)  # -> Model, MeshesOfRenderedShells, LegendColours, LegendTags
beam_view_karamba3d = BeamView(Model=model_view_karamba3d.Model)  # -> Model, MeshesOfRenderedBeams, DeformedBeamAxes, LegendColours, LegendTags
legend = Legend(Colour=beam_view_karamba3d.LegendColours, Tags=beam_view_karamba3d.LegendTags, LegendType=1)
legend_2 = Legend(Colour=shell_view_karamba3d.LegendColours, Tags=shell_view_karamba3d.LegendTags, LegendType=1)
panel_17 = Panel(beam_forces_karamba3d.NormalForce_kN)
panel_18 = Panel(beam_forces_karamba3d.BendingMomentMy_kNm)

# ----
# MAKING THE GRID AND FLATPACKING THE ELEMENTS
bounding_box_4 = BoundingBox(Content=flatten(arched_elements), Plane=PlaneXY(0, 0, 0), UnionBox=True)  # -> Box, Box_2
length_4 = Length(Curve=merge_6)
deconstruct_brep_3 = DeconstructBrep(Brep=bounding_box_4.Box)  # -> Faces, Edges, Vertices
deconstruct_3 = Deconstruct(Point=deconstruct_brep_3.Vertices)  # -> XComponent, YComponent, ZComponent
sort_list_4 = SortList(Keys=deconstruct_3.ZComponent, ValuesValuesA=deconstruct_brep_3.Vertices)  # -> Keys, ValuesValuesA
list_item_11 = ListItem(List=sort_list_4.ValuesValuesA, Index=0, Wrap=True)
trim_tree_13 = TrimTree(Tree=merge_6, Depth=1)
sort_list_5 = SortList(Keys=flatten(length_4))  # -> reverse(Keys), ValuesValuesA
tree_statistics_5 = TreeStatistics(Tree=trim_tree_13)  # -> Paths, Length, Count
list_item_12 = ListItem(List=sort_list_5.Keys, Index=0, Wrap=True)
list_item_13 = ListItem(List=tree_statistics_5.Length, Index=0, Wrap=True)
rectangular = Rectangular(
    Plane=list_item_11,
    SizeX=expr("(x*2)*10", bundel_radius),
    SizeY=expr("x*1.2", list_item_12),
    ExtentX=list_item_13,
    ExtentY=tree_statistics_5.Count)  # -> simplify(Cells), Points
flip_matrix = FlipMatrix(Data=rectangular.Cells)
area_7 = Area(Geometry=flip_matrix)  # -> Area, Centroid
xz_plane = XZPlane(Origin=area_7.Centroid)

# ----
# MAKING THE VERTICAL FLATPACKED SEGMENTS
end_points_7 = EndPoints(Curve=extend_curve)  # -> Start, End
end_points_8 = EndPoints(Curve=extend_curve_2)  # -> Start, End
point_3 = Point(end_points_7.Start)
point_4 = Point(end_points_8.End)
unit_z_5 = UnitZ(Factor=1)
line_sdl_3 = LineSDL(Start=[point_3, point_4], Direction=unit_z_5, Length=length_4)
pipe_3 = Pipe(Curve=line_sdl_3, Radius=bundel_radius, Caps=0)  # -> simplify(Pipe)

curve_middle_4 = CurveMiddle(Curve=line_sdl_3)
xy_plane = XYPlane(Origin=curve_middle_4)
trim_tree_14 = TrimTree(Tree=line_sdl_3, Depth=1)
trim_tree_15 = TrimTree(Tree=xy_plane, Depth=1)
orient_2 = Orient(Geometry=trim_tree_14, Source=trim_tree_15, Target=xz_plane)  # -> Geometry, Transform
flat_grid_of_elements = Pipe(Curve=orient_2.Geometry, Radius=bundel_radius, Caps=0)

# ----
# LABELLING OF THE FLATPACKED ELEMENTS
panel_19 = Panel("1")
series = Series(Start=panel_19, Step=panel_19, Count=expr("x/2", tree_statistics_5.Count))  # -> graft(Series)
series_2 = Series(Start="1", Step="1", Count=tree_statistics_5.Length)
series_3 = Series(Start="1", Step="1", Count="2")
end_points_9 = EndPoints(Curve=orient_2.Geometry)  # -> Start, End
concatenate = Concatenate(Fragment_A="Module", Fragment_B=":", A=series_2)  # -> graft(Result)
concatenate_2 = Concatenate(Fragment_A="Arc", Fragment_B=" ", A=series, B=".", C=series_3)  # -> flatten(Result)
concatenate_3 = Concatenate(Fragment_A=concatenate, Fragment_B="|", A=concatenate_2)  # -> simplify(Result)
panel_20 = Panel(concatenate_3)

# ---- group: Element Labels
text_tag_2 = TextTag(Location=end_points_9.Start, Text=concatenate_3)

# ----
# LABELLING THE NODES
panel_21 = Panel("1")
series_4 = Series(Start=panel_21, Step=panel_21, Count=expr("x/2", tree_statistics_5.Count))  # -> graft(Series)
series_5 = Series(Start="1", Step="1", Count=tree_statistics_5.Length)
merge_12 = Merge(Data1="A", Data2="B", Data3="C", Data4="D")
concatenate_4 = Concatenate(Fragment_A="Module", Fragment_B=" ", A=series_5)  # -> graft(Result)
concatenate_5 = Concatenate(Fragment_A="Node", Fragment_B=" ", A=series_4, B=".", C=merge_12)  # -> flatten(Result)
concatenate_6 = Concatenate(Fragment_A=concatenate_4, Fragment_B="|", A=concatenate_5)  # -> simplify(Result)
trim_tree_16 = TrimTree(Tree=arco_reference_points, Depth=1)

# ---- group: Element Labels
text_tag_3 = TextTag(Location=trim_tree_16, Text=concatenate_6)

# ----
# DECOMPOSITION OF INDIVIDUAL ELEMENTS (OF 1 ARCH) (FOR UNITY)
# Arches (Curve)
# Arches (Pipe)
# Straight members
# Text for Flatpack members
# Text for Aruco Markers
# Aruco Markers
# Foundation Tires
explode_tree = ExplodeTree(Data=simplify(merge_6))
trim_tree_17 = TrimTree(Tree=pipe_2, Depth=1)
trim_tree_18 = TrimTree(Tree=pipe_3, Depth=1)
trim_tree_19 = TrimTree(Tree=flat_grid_of_elements, Depth=1)
trim_tree_20 = TrimTree(Tree=arco_reference_points, Depth=1)
explode_tree_2 = ExplodeTree(Data=concatenate_6)
explode_tree_3 = ExplodeTree(Data=merge_11)
data_10 = Data(orient.Geometry)
explode_tree_4 = ExplodeTree(Data=simplify(trim_tree_17))
explode_tree_5 = ExplodeTree(Data=trim_tree_18)
explode_tree_6 = ExplodeTree(Data=trim_tree_19)
explode_tree_7 = ExplodeTree(Data=concatenate_3)
explode_tree_8 = ExplodeTree(Data=trim_tree_20)
list_item_14 = ListItem(List=explode_tree, Index=0, Wrap=True)  # -> Item, Item1
list_item_15 = ListItem(List=explode_tree_4, Index=0, Wrap=True)  # -> Item, Item1
list_item_16 = ListItem(List=explode_tree_5, Index=0, Wrap=True)  # -> Item, Item1
list_item_17 = ListItem(List=explode_tree_6, Index=0, Wrap=True)  # -> Item, Item1
list_item_18 = ListItem(List=explode_tree_7, Index=0, Wrap=True)  # -> Item, Item1
list_item_19 = ListItem(List=explode_tree_8, Index=0, Wrap=True)  # -> Item, Item1, Item2, Item3
list_item_20 = ListItem(List=explode_tree_2, Index=0, Wrap=True)  # -> Item, Item1, Item2, Item3
list_item_21 = ListItem(List=flatten(data_10), Index=0, Wrap=True)  # -> Item, Item1, Item2, Item3
curve = Curve(list_item_14.Item)
curve_2 = Curve(list_item_14.Item1)
brep_3 = Brep(list_item_17.Item)
brep_4 = Brep(list_item_17.Item1)
point_5 = Point(list_item_19.Item1)
point_6 = Point(list_item_19.Item2)
point_7 = Point(list_item_19.Item3)
point_8 = Point(list_item_19.Item)
mesh = Mesh(list_item_21.Item1)
mesh_2 = Mesh(list_item_21.Item2)
curve_curve = CurveCurve(CurveA=curve, CurveB=curve_2)  # -> Points, ParamsA, ParamsB
volume_2 = Volume(Geometry=brep_3)  # -> Volume, Centroid
volume_3 = Volume(Geometry=brep_4)  # -> Volume, Centroid
shatter_4 = Shatter(Curve=curve, Parameters=curve_curve.ParamsA)
text_tag_4 = TextTag(
    Location=[point_8, point_5, point_6, point_7],
    Text=[list_item_20.Item, list_item_20.Item1, list_item_20.Item2, list_item_20.Item3])
text_tag_5 = TextTag(Location=[volume_2.Centroid, volume_3.Centroid], Text=[list_item_18.Item, list_item_18.Item1])
list_item_22 = ListItem(List=shatter_4, Index=0, Wrap=True)  # -> Item, Item1
curve_3 = Curve(list_item_22.Item1)
pipe_4 = Pipe(Curve=curve_3, Radius=bundle_radius, Caps=0)
mesh_3 = Mesh(list_item_21.Item3)
brep_5 = Brep(list_item_15.Item)
brep_6 = Brep(list_item_15.Item1)
brep_7 = Brep(list_item_16.Item)
brep_8 = Brep(list_item_16.Item1)
data_11 = Data(explode_tree_3)
mesh_4 = Mesh(list_item_21.Item)

# ----
# GETTING THE POINTS FROM PYTHON
# (for comparing it with the original arch)
aruco_marker_4_node_d = FilePath("C:\Users\artem\OneDrive\Documents\Artemisia\02_Professional\TUDelft\10_Creative_Robotics\Assignments\Group_project\Unity\ArUco_Markers\vectors\marker_4.txt")
aruco_marker_1_node_a = FilePath("C:\Users\artem\OneDrive\Documents\Artemisia\02_Professional\TUDelft\10_Creative_Robotics\Assignments\Group_project\Unity\ArUco_Markers\vectors\marker_1.txt")
aruco_marker_2_node_b = FilePath("C:\Users\artem\OneDrive\Documents\Artemisia\02_Professional\TUDelft\10_Creative_Robotics\Assignments\Group_project\Unity\ArUco_Markers\vectors\marker_2.txt")
aruco_marker_3_node_c = FilePath("C:\Users\artem\OneDrive\Documents\Artemisia\02_Professional\TUDelft\10_Creative_Robotics\Assignments\Group_project\Unity\ArUco_Markers\vectors\marker_3.txt")
origin = Data(mesh_closest_point.Point)
nodes_to_track = ExplodeTree(Data=arco_reference_points)
arch = ExplodeTree(Data=arched_elements)
list_item_23 = ListItem(List=reverse(nodes_to_track), Index=0, Wrap=True)  # -> Item, Item1, Item2, Item3
read_file = ReadFile(File=aruco_marker_1_node_a, PerLineParse=True)
read_file_2 = ReadFile(File=aruco_marker_2_node_b, PerLineParse=True)
read_file_3 = ReadFile(File=aruco_marker_3_node_c, PerLineParse=True)
read_file_4 = ReadFile(File=aruco_marker_4_node_d, PerLineParse=True)
marker_1_node_a = Data(list_item_23.Item)
marker_2_node_b = Data(list_item_23.Item1)
marker_3_node_c = Data(list_item_23.Item2)
marker_4_node_d = Data(list_item_23.Item3)
line_4 = Line(StartPoint=origin, EndPoint=marker_1_node_a)
line_5 = Line(StartPoint=origin, EndPoint=marker_2_node_b)
line_6 = Line(StartPoint=origin, EndPoint=marker_3_node_c)
line_7 = Line(StartPoint=origin, EndPoint=marker_4_node_d)
merge_13 = Merge(Data1=marker_1_node_a, Data2=marker_2_node_b, Data3=marker_3_node_c, Data4=marker_4_node_d)
vector = Vector(line_4)
vector_2 = Vector(line_5)
vector_3 = Vector(line_6)
vector_4 = Vector(line_7)
move_4 = Move(Geometry=origin, Motion=read_file)  # -> Geometry, Transform
move_5 = Move(Geometry=origin, Motion=read_file_2)  # -> Geometry, Transform
move_6 = Move(Geometry=origin, Motion=read_file_3)  # -> Geometry, Transform
move_7 = Move(Geometry=origin, Motion=read_file_4)  # -> Geometry, Transform
merge_14 = Merge(Data1=move_4.Geometry, Data2=move_5.Geometry, Data3=move_6.Geometry, Data4=move_7.Geometry)

# ---- group: original arch
arch_1 = Data(arch)

# ----
panel_22 = Panel(vector)
panel_23 = Panel(vector_2)
panel_24 = Panel(vector_3)
panel_25 = Panel(vector_4)
panel_26 = Panel(read_file)
panel_27 = Panel(read_file_2)
panel_28 = Panel(read_file_4)
panel_29 = Panel(read_file_3)

divide_length_2 = DivideLength(Curve=arch_1, Length="0.2")  # -> Points, Tangents, Parameters
curve_closest_point = CurveClosestPoint(Point=merge_13, Curve=arch_1)  # -> Point, Parameter, Distance

# ----
# KANGAROO FORMFINDING
merge_15 = Merge(Data1=divide_length_2.Points, Data2=curve_closest_point.Point)  # -> flatten(Result)
shatter_5 = Shatter(Curve=arch_1, Parameters=divide_length_2.Parameters)
explode_tree_9 = ExplodeTree(Data=axial_strength)
sort_along_curve_4 = SortAlongCurve(Points=merge_15, Curve=arch_1)  # -> Points, Indices
list_item_24 = ListItem(List=explode_tree_9, Index=0, Wrap=True)
polyline_2 = PolyLine(Vertices=sort_along_curve_4.Points, Closed=False)
rod_2 = Rod(Polyline=polyline_2, LengthFactor=1, AngleFactor="0", AxialStrength=list_item_24, BendStrength=bending_strength)  # -> simplify(R)
length_line = LengthLine(Line=shatter_5, Strength=10)
anchor_2 = Anchor(Point=curve_closest_point.Point, Target=merge_14, Strength=10000)  # -> simplify(A)
merge_16 = Merge(Data1=length_line, Data2=rod_2, Data3=anchor_2)

solver_2 = Solver(GoalObjects=merge_16, Reset=Button(), Threshold=1e-15, Tolerance=0.0001, On=Toggle(True))  # -> I, V, O
